# Dynamo graph Join_by_category_v3_WebRequest.dyn (Dynamo 1.3.4.6666)

forceChildrensEval = ForceChildrensEval()  # unwired: arg0
webRequestGitHab = Python(IN[0]=forceChildrensEval)
# ---------- webRequestGitHab.python (59 lines) ----------
# -*- coding: utf-8 -*- 
#-----------------------Импоорт библиотек----------------------
import clr
import sys 
sys.path.append("C:\Program Files (x86)\IronPython 2.7\Lib")
import os
#import gitlab

import System
from System import Guid
from System import DateTime
from System.IO import StreamReader
from System.Net import WebRequest, HttpRequestHeader
clr.AddReference('System.Web.Extensions')
from System.Web.Script.Serialization import JavaScriptSerializer 

from System import Type, Activator, IO, Text, Uri, Convert
#Excel = Activator.CreateInstance(Type.GetTypeFromProgID("Excel.Application"))

file_path = 'C:\\temp\\githab_code.py'

#-----------------------ФУНКЦИИ----------------------
def flatten(container):
	for i in container:
		if isinstance(i, (list,tuple)):
			for j in flatten(i):
				yield j
		else:
			yield i

def LogSaveStrList(string_list):
	IO.File.AppendAllLines(file_path, flatten(string_list), Text.Encoding.Unicode)

def LogSaveStr(string):
	IO.File.WriteAllText(file_path, string, Text.Encoding.Unicode)
	

def rsnrequest():
	request = WebRequest.Create('https://api.github.com/repos/Babinoff/Join_Unjoin/contents/Join_by_category_main.py?ref=master')
	request.Method = "GET"
	request.UserAgent = "Anything"
	#request.ServicePoint.Expect100Continue = False
	token = '2f4c54160568dad4f3cd002ab358d9bf935ef133'
	#request.Headers.Add(HttpRequestHeader.Authorization, token)
	request.Headers["OAUTH-TOKEN"] = token
	rsp = request.GetResponse()
	stream_reader = StreamReader(rsp.GetResponseStream())
	jsonData = stream_reader.ReadToEnd()
	stream_reader.Close()
	json = JavaScriptSerializer().DeserializeObject(jsonData)
	return json
	
json_recv = rsnrequest()
data_from_json = json_recv["content"]
base64EncodedBytes = System.Convert.FromBase64String(data_from_json)
python_code_string = System.Text.Encoding.UTF8.GetString(base64EncodedBytes)
LogSaveStr(python_code_string)

OUT = python_code_string
# ----------------------------------------
список_категорий = StringInput("Части, Стены, Перекрытия, Несущие колонны, Каркас несущий")
объединить_геометрию_разделить = BoolSelector(false)  # "Объединить геометрию /// Разделить геометрию"
python_script_from_string = PythonStringNode(script=webRequestGitHab, IN[0]=список_категорий, IN[1]=объединить_геометрию_разделить)
